# Grasshopper definition Generative design excercise.gh (Grasshopper 1.0.7)
# plug-ins: sof_gh_sofistik_rhino

io = IO(
    SofistikDocumentProperties_VersionMajor="2020",
    SofistikDocumentProperties_VersionMinor="8",
    SofistikDocumentProperties_VersionName="Rhino-Interface")
number_slider = Slider(23, range=20..30)
floors_in_tower = Slider(107, range=1..110)  # disabled
floors_in_tower_2 = Slider(14, range=1..110)  # disabled
floors_in_tower_3 = Slider(83, range=1..110)  # disabled
floors_in_tower_4 = Slider(50, range=1..110)  # disabled
floors_in_tower_5 = Slider(17, range=1..110)  # disabled
number_slider_2 = Slider(23, range=20..30)  # disabled
floors_in_tower_6 = Slider(93, range=1..110)  # disabled
floors_in_tower_7 = Slider(99, range=1..110)  # disabled
floors_in_tower_8 = Slider(67, range=1..110)  # disabled
floors_in_tower_9 = Slider(107, range=1..110)  # disabled
number_slider_3 = Slider(3, range=0..10)
floors_in_tower_10 = Slider(14, range=1..110)  # disabled
floors_in_tower_11 = Slider(83, range=1..110)  # disabled
floors_in_tower_12 = Slider(50, range=1..110)  # disabled
floors_in_tower_13 = Slider(72, range=1..110)  # disabled
floors_in_tower_14 = Slider(46, range=1..110)  # disabled
floors_in_tower_15 = Slider(99, range=1..110)  # disabled
floors_in_tower_16 = Slider(67, range=1..110)  # disabled
number_slider_4 = Slider(3, range=0..10)  # disabled
series = Series(Start=Slider(30, range=0..100), Step=Slider(30, range=0..100), Count=Slider(3, range=0..10))
floors_in_tower_17 = Slider(93, range=1..110)  # disabled
floors_in_tower_18 = Slider(25, range=1..110)  # disabled
floors_in_tower_19 = Slider(14, range=1..110)  # disabled
floors_in_tower_20 = Slider(83, range=1..110)  # disabled
floors_in_tower_21 = Slider(50, range=1..110)  # disabled
floors_in_tower_22 = Slider(72, range=1..110)  # disabled
floors_in_tower_23 = Slider(99, range=1..110)  # disabled
floors_in_tower_24 = Slider(67, range=1..110)  # disabled
floor_hts = Slider(4.5, range=0..10)
floor_hts_2 = Slider(4.5, range=0..10)  # disabled
sqgrid = Square(Plane=PlaneXY(0, 0, 0), Size=number_slider, ExtentX=number_slider_3, ExtentY=number_slider_3)  # -> Cells, Points
sqgrid_2 = Square(Plane=PlaneXY(0, 0, 0), Size=number_slider_2, ExtentX=number_slider_4, ExtentY=number_slider_4)  # -> Cells, Points; disabled
crossref = CrossReference(
    ListA=series,
    ListB=series,
    ListC=series,
    ListD=series,
    ListE=series,
    ListF=series,
    ListG=series,
    ListH=series,
    CrossMode=1)  # -> ListA, ListB, ListC, ListD, ListE, ListF, ListG, ListH
crv = Curve(flatten(sqgrid.Cells))
crv_2 = Curve(flatten(sqgrid_2.Cells))  # disabled
merge = Merge(
    Data1=graft(crossref.ListA),
    Data2=graft(crossref.ListB),
    Data3=graft(crossref.ListC),
    Data4=graft(crossref.ListD),
    Data6=graft(crossref.ListE),
    Data7=graft(crossref.ListF),
    Data8=graft(crossref.ListG),
    Data9=graft(crossref.ListH))
merge_2 = Merge(
    Data1=graft([floors_in_tower_18, floors_in_tower_9, floors_in_tower]),
    Data2=graft([floors_in_tower_24, floors_in_tower_16, floors_in_tower_8]),
    Data3=graft([floors_in_tower_21, floors_in_tower_12, floors_in_tower_4]),
    Data4=graft([floors_in_tower_17, floors_in_tower_14, floors_in_tower_6]),
    Data6=graft([floors_in_tower_23, floors_in_tower_15, floors_in_tower_7]),
    Data7=graft([floors_in_tower_19, floors_in_tower_10, floors_in_tower_2]),
    Data8=graft([floors_in_tower_20, floors_in_tower_11, floors_in_tower_3]),
    Data9=graft([floors_in_tower_22, floors_in_tower_13, floors_in_tower_5]))  # disabled
number_slider_5 = Slider(4, range=0..10)  # disabled
sort = SortList(Keys=merge)  # -> reverse(Keys), ValuesA
sort_2 = SortList(Keys=merge_2)  # -> reverse(Keys), ValuesA; disabled
split = SplitList(List=merge, Index=Slider(4, range=0..10))  # -> ListA, ListB
item = ListItem(List=sort.Keys, Index=0, Wrap=True)
split_2 = SplitList(List=merge_2, Index=number_slider_5)  # -> ListA, ListB; disabled
item_2 = ListItem(List=sort_2.Keys, Index=0, Wrap=True)  # disabled
merge_3 = Merge(Data1=simplify(split.ListA), Data2=simplify(item), Data3=simplify(split.ListB))
merge_4 = Merge(Data1=simplify(split_2.ListA), Data2=simplify(item_2), Data3=simplify(split_2.ListB))  # disabled
multiplication = Multiplication(A=floor_hts_2, B=merge_4)  # disabled
Z = UnitZ(Factor=multiplication)  # disabled
extr = Extrude(Base=crv_2, Direction=Z)  # disabled
cap = CapHoles(Brep=extr)  # disabled
geo = Geometry(cap)  # disabled
num = Number(floor_hts)
num_2 = Number(floor_hts_2)  # disabled
join = TextJoin(Text=merge_3, Join="-")

# ---- group: Fast area calculaiton
ma = MassAddition(Input=merge_3)  # -> Result, PartialResults
num_3 = Number(number_slider)
multiplication_2 = Multiplication(A=num_3, B=num_3, C=ma.Result)

# ----
floor_area = Panel(multiplication_2)
contour = Contour(Shape=geo, Point=Point(0, 0, 0), Direction=Vector(0, 0, 1), Distance=num_2)  # disabled

# ---- group: Fast area calculaiton
ma_2 = MassAddition(Input=merge_4)  # -> Result, PartialResults; disabled
num_4 = Number(number_slider_2)  # disabled
multiplication_3 = Multiplication(A=num_4, B=num_4, C=ma_2.Result)  # disabled

# ----
floor_area_2 = Panel(multiplication_3)  # disabled

# ---- group: Slow area calculaiton
crv_3 = Curve(contour)  # disabled
area = Area(Geometry=crv_3)  # -> Area, Centroid; disabled
ma_3 = MassAddition(Input=flatten(area.Area))  # -> Result, PartialResults; disabled

# ----
larger = LargerThan(FirstNumber=multiplication_2, SecondNumber=Slider(390000, range=0..10000000))  # -> LargerThan, OrEqualTo
cull = CullPattern(List=join, CullPattern=larger.OrEqualTo)
split_3 = TextSplit(Text=cull, Separators="-")
clean = CleanTree(RemoveNulls=True, RemoveInvalid=True, RemoveEmpty=True, Tree=split_3)
new_height = Integer(clean)
multiplication_4 = Multiplication(A=floor_hts, B=new_height)

# ---- group: Mesh base
num_5 = Number(number_slider)
area_2 = Area(Geometry=crv)  # -> Area, Centroid
division = Division(A=num_5, B=Slider(2, range=0..10))
dom = ConstructDomain(DomainStart=expr("-x", division), DomainEnd=division)
number_slider_6 = Slider(1, range=0..1)
box = DomainBox(Base=area_2.Centroid, X=dom, Y=dom, Z=multiplication_4)
mbox = MeshBox(Base=box, XCount=number_slider_6, YCount=number_slider_6, ZCount=number_slider_6)

# ----
Z_2 = UnitZ(Factor=multiplication_4)  # disabled
extr_2 = Extrude(Base=crv, Direction=Z_2)  # disabled
cap_2 = CapHoles(Brep=extr_2)  # disabled
geo_2 = Geometry(cap_2)  # disabled
geo_3 = Geometry(mbox)
contour_2 = Contour(Shape=geo_3, Point=Point(0, 0, 0), Direction=Vector(0, 0, 1), Distance=num)

# ---- group: Slow area calculaiton
crv_4 = Curve(contour_2)  # disabled
area_3 = Area(Geometry=crv_4)  # -> Area, Centroid; disabled
ma_4 = MassAddition(Input=flatten(area_3.Area))  # -> Result, PartialResults; disabled

# ---- group: sUN PATH
sph = Sphere(Base=PlaneXY(0, 0, 0), Radius=Slider(550, range=0..1000))
sec = BrepPlane(Brep=sph, Plane=PlaneXY(0, 0, 0))  # -> Curves, Points
srfsplit = SurfaceSplit(Surface=sph, Curves=sec.Curves)
pt = ConstructPoint(XCoordinate=Slider(0.14, range=0..1), YCoordinate=Slider(0.98, range=0.5..1), ZCoordinate=0)
item_3 = ListItem(List=srfsplit, Index=0, Wrap=True)
evalsrf = EvaluateSurface(Surface=reparameterize(item_3), Point=pt)  # -> Point, Normal, UDirection, VDirection, Frame
iso = IsoCurve(Surface=reparameterize(item_3), UVPoint=pt)  # -> UIsocurve, VIsocurve
vec = Vector(evalsrf.Point)
pt_2 = Point(evalsrf.Point)
rev = Reverse(Vector=vec)
amp = Amplitude(Vector=rev, Amplitude=Slider(100, range=0..100))
vdisex = VectorDisplayEx(Point=pt_2, Vector=amp, Colour=RGB(0, 0, 0), Width=2)
vec_2 = Vector(rev)

number_slider_7 = Slider(550, range=0..1000)  # disabled
sph_2 = Sphere(Base=PlaneXY(0, 0, 0), Radius=number_slider_7)  # disabled
number_slider_8 = Slider(0.14, range=0..1)  # disabled
number_slider_9 = Slider(0.98, range=0.5..1)  # disabled
sec_2 = BrepPlane(Brep=sph_2, Plane=PlaneXY(0, 0, 0))  # -> Curves, Points; disabled
srfsplit_2 = SurfaceSplit(Surface=sph_2, Curves=sec_2.Curves)  # disabled
pt_3 = ConstructPoint(XCoordinate=number_slider_8, YCoordinate=number_slider_9, ZCoordinate=0)  # disabled
item_4 = ListItem(List=srfsplit_2, Index=0, Wrap=True)  # disabled
evalsrf_2 = EvaluateSurface(Surface=reparameterize(item_4), Point=pt_3)  # -> Point, Normal, UDirection, VDirection, Frame; disabled
number_slider_10 = Slider(100, range=0..100)  # disabled
iso_2 = IsoCurve(Surface=reparameterize(item_4), UVPoint=pt_3)  # -> UIsocurve, VIsocurve; disabled
vec_3 = Vector(evalsrf_2.Point)  # disabled
pt_4 = Point(evalsrf_2.Point)  # disabled
rev_2 = Reverse(Vector=vec_3)  # disabled
amp_2 = Amplitude(Vector=rev_2, Amplitude=number_slider_10)  # disabled
vdisex_2 = VectorDisplayEx(Point=pt_4, Vector=amp_2, Colour=RGB(0, 0, 0), Width=2)  # disabled
vec_4 = Vector(rev_2)  # disabled

# ----
mshadow = MeshShadow(Mesh=geo_3, Light=vec_2, Plane=PlaneXY(0, 0, 0))
mshadow_2 = MeshShadow(Mesh=geo, Light=vec_4, Plane=PlaneXY(0, 0, 0))  # disabled
path_mapper = PathMapper(mshadow, source="{A;B;C;D}", target="{A;B;C}")
path_mapper_2 = PathMapper(mshadow_2, source="{A;B;C;D}", target="{A;B;C}")  # disabled
runion = RegionUnion(Curves=path_mapper)
runion_2 = RegionUnion(Curves=path_mapper_2)  # disabled

# ---- group: Shadow check
shadow = Curve(runion)
area_4 = Area(Geometry=shadow)  # -> Area, Centroid
neighbour = Curve(<curve referenced from the Rhino model>)
park = Curve(<curve referenced from the Rhino model>)
int = Integer(area_4.Area)
rint = RegionIntersection(CurvesA=shadow, CurvesB=neighbour)
rint_2 = RegionIntersection(CurvesA=shadow, CurvesB=park)
area_5 = Area(Geometry=rint)  # -> Area, Centroid
area_6 = Area(Geometry=rint_2)  # -> Area, Centroid
null = NullItem(Item=rint)  # -> NullFlags, InvalidFlags, Description
null_2 = NullItem(Item=rint_2)  # -> NullFlags, InvalidFlags, Description
weave = Weave(Pattern=null_2.NullFlags, Stream0=area_6.Area, Stream1=Slider(0, range=0..100), NullGaps=False)
int_2 = Integer(weave)
weave_2 = Weave(Pattern=null.NullFlags, Stream0=area_5.Area, Stream1=Slider(0, range=0..100), NullGaps=False)
int_3 = Integer(weave_2)

# ----
park_shadow = Panel(int_2)
total_shadown = Panel(int)
nghr_shadow = Panel(int_3)

# ---- group: Shadow check
shadow_2 = Curve(runion_2)  # disabled
area_7 = Area(Geometry=shadow_2)  # -> Area, Centroid; disabled
neighbour_2 = Curve(<curve referenced from the Rhino model>)  # disabled
park_2 = Curve(<curve referenced from the Rhino model>)  # disabled
int_4 = Integer(area_7.Area)  # disabled
rint_3 = RegionIntersection(CurvesA=shadow_2, CurvesB=neighbour_2)  # disabled
rint_4 = RegionIntersection(CurvesA=shadow_2, CurvesB=park_2)  # disabled
area_8 = Area(Geometry=rint_3)  # -> Area, Centroid; disabled
area_9 = Area(Geometry=rint_4)  # -> Area, Centroid; disabled
number_slider_11 = Slider(0, range=0..100)  # disabled
number_slider_12 = Slider(0, range=0..100)  # disabled
null_3 = NullItem(Item=rint_3)  # -> NullFlags, InvalidFlags, Description; disabled
null_4 = NullItem(Item=rint_4)  # -> NullFlags, InvalidFlags, Description; disabled
weave_3 = Weave(Pattern=null_3.NullFlags, Stream0=area_8.Area, Stream1=number_slider_11, NullGaps=False)  # disabled
int_5 = Integer(weave_3)  # disabled
weave_4 = Weave(Pattern=null_4.NullFlags, Stream0=area_9.Area, Stream1=number_slider_12, NullGaps=False)  # disabled
int_6 = Integer(weave_4)  # disabled

# ----
total_shadown_2 = Panel(int_4)  # disabled
park_shadow_2 = Panel(int_6)  # disabled
nghr_shadow_2 = Panel(int_5)  # disabled
panel = Panel(path_mapper)
panel_2 = Panel(path_mapper_2)  # disabled

# ---- group: Matrix tower logic
group = Group(Objects=geo_3)
geo_4 = Geometry(flatten(group))
sqgrid_3 = Square(Plane=PlaneXY(0, 0, 0), Size=Slider(300, range=0..1000), ExtentX=Slider(4, range=0..10), ExtentY=Slider(4, range=0..10))  # -> Cells, Points
lng = ListLength(List=geo_4)
pt_5 = Point(flatten(sqgrid_3.Points))
shadow_3 = Curve(flatten(shadow))
lng_2 = ListLength(List=pt_5)
min = Minimum(A=lng, B=lng_2)
split_4 = SplitList(List=geo_4, Index=min)  # -> ListA, ListB
split_5 = SplitList(List=pt_5, Index=min)  # -> ListA, ListB
split_6 = SplitList(List=shadow_3, Index=min)  # -> ListA, ListB
move = Move(Geometry=split_4.ListA, Motion=split_5.ListA)  # -> Geometry, Transform
move_2 = Move(Geometry=split_6.ListA, Motion=split_5.ListA)  # -> Geometry, Transform

number_slider_13 = Slider(300, range=0..1000)  # disabled
number_slider_14 = Slider(4, range=0..10)  # disabled
number_slider_15 = Slider(4, range=0..10)  # disabled
group_2 = Group(Objects=geo)  # disabled
geo_5 = Geometry(flatten(group_2))  # disabled
sqgrid_4 = Square(Plane=PlaneXY(0, 0, 0), Size=number_slider_13, ExtentX=number_slider_15, ExtentY=number_slider_14)  # -> Cells, Points; disabled
lng_3 = ListLength(List=geo_5)  # disabled
pt_6 = Point(flatten(sqgrid_4.Points))  # disabled
shadow_4 = Curve(flatten(shadow_2))  # disabled
lng_4 = ListLength(List=pt_6)  # disabled
min_2 = Minimum(A=lng_3, B=lng_4)  # disabled
split_7 = SplitList(List=geo_5, Index=min_2)  # -> ListA, ListB; disabled
split_8 = SplitList(List=pt_6, Index=min_2)  # -> ListA, ListB; disabled
split_9 = SplitList(List=shadow_4, Index=min_2)  # -> ListA, ListB; disabled
move_3 = Move(Geometry=split_7.ListA, Motion=split_8.ListA)  # -> Geometry, Transform; disabled
move_4 = Move(Geometry=split_9.ListA, Motion=split_8.ListA)  # -> Geometry, Transform; disabled

# ---- group: text data
merge_5 = Merge(Data1=simplify(multiplication_2), Data2=simplify(int), Data3=simplify(int_2), Data4=simplify(int_3))
panel_3 = Panel("""Floor area: 
Shadow area: 
Park area: 
neighbour area: """)
concat = Concatenate(FragmentA=panel_3, FragmentB=merge_5)
join_2 = TextJoin(Text=concat)
data = Data(flatten(join_2))
split_10 = SplitList(List=data, Index=min)  # -> ListA, ListB
tag = TextTag3D(Location=split_5.ListA, Text=split_10.ListA, Size=Slider(10, range=0..10), Justification=1)

merge_6 = Merge(Data1=simplify(multiplication_3), Data2=simplify(int_4), Data3=simplify(int_6), Data4=simplify(int_5))  # disabled
panel_4 = Panel("")  # disabled
panel_5 = Panel("""Floor area: 
Shadow area: 
Park area: 
neighbour area: """)  # disabled
concat_2 = Concatenate(FragmentA=panel_5, FragmentB=merge_6)  # disabled
join_3 = TextJoin(Text=concat_2, Join=panel_4)  # disabled
data_2 = Data(flatten(join_3))  # disabled
number_slider_16 = Slider(10, range=0..10)  # disabled
split_11 = SplitList(List=data_2, Index=min_2)  # -> ListA, ListB; disabled
tag_2 = TextTag3D(Location=split_8.ListA, Text=split_11.ListA, Size=number_slider_16, Justification=1)  # disabled
